# Dynamo graph 6514552471_DYNAMO_HYBRID TRUSS.dyn "20240522_MODEL TRUSS LIST_CHANGE H" (Dynamo 2.17.0.3472)
# packages: Structural Analysis for Dynamo 2.11.0, Structural Analysis for Dynamo 2.17.0

code_block = CodeBlock { x=0; y=0; }

# group: INPUT
height = DoubleSlider(1.6, range=0.6..1.6 step 0.2)  # graph input
length = DoubleSlider(12, range=0..15 step 1)
จำนวนช_อง = IntegerSlider(15, range=3..15 step 2)  # graph input

# group: NODE
byCoordinates = Point.ByCoordinates(x=code_block.y, z=height)
byCoordinates_2 = Point.ByCoordinates(x=length, z=height)
byCoordinates_3 = Point.ByCoordinates(x=code_block.x, y=code_block.y)
byCoordinates_4 = Point.ByCoordinates(x=length, y=code_block.y)

top_chord_line = Line.ByStartPointEndPoint(startPoint=byCoordinates, endPoint=byCoordinates_2)
top_analyticalbar_byline = DynamoSimulation.RSA.AnalyticalModel.AnalyticalBar.ByLine(line=top_chord_line)
sections = SectionBar("PIP 101.6x4")
setSectionByName = DynamoSimulation.RSA.AnalyticalModel.AnalyticalBar.SetSectionByName(analyticalBars=top_analyticalbar_byline, name=sections)
case_nature = CaseNature("Dead")
code_block_2 = CodeBlock { "DL1"; }
byNature = DynamoSimulation.RSA.AnalyticalModel.Loads.LoadCase.ByNature(caseNature=case_nature, caseName=code_block_2)
code_block_3 = CodeBlock { -10; }
byBars = DynamoSimulation.RSA.AnalyticalModel.Loads.UniformMemberLoad.ByBars(analyticalBars=setSectionByName, loadCase=byNature, fz=code_block_3)
botton_chord_line = Line.ByStartPointEndPoint(startPoint=byCoordinates_3, endPoint=byCoordinates_4)
# note: SET SECTION
bottom_analyticalbar_byline = DynamoSimulation.RSA.AnalyticalModel.AnalyticalBar.ByLine(line=botton_chord_line)
sections_2 = SectionBar("PIP 101.6x4")
setSectionByName_2 = DynamoSimulation.RSA.AnalyticalModel.AnalyticalBar.SetSectionByName(analyticalBars=bottom_analyticalbar_byline, name=sections_2)

# group: SET SUPPORTS
byPoint = DynamoSimulation.RSA.AnalyticalModel.AnalyticalNode.ByPoint(point=byCoordinates_3)
supports = Support("Pinned")
setSupportByName = DynamoSimulation.RSA.AnalyticalModel.AnalyticalNode.SetSupportByName(nodes=byPoint, name=supports)
byPoint_2 = DynamoSimulation.RSA.AnalyticalModel.AnalyticalNode.ByPoint(point=byCoordinates_4)
supports_2 = Support("Fixed")
# note: SUPPORT
setSupportByName_2 = DynamoSimulation.RSA.AnalyticalModel.AnalyticalNode.SetSupportByName(nodes=byPoint_2, name=supports_2)

code_block_4 = CodeBlock(n=จำนวนช_อง) { 0..1..#n; }
pointAtParameter = Curve.PointAtParameter(curve=botton_chord_line, param=code_block_4)
pointAtParameter_2 = Curve.PointAtParameter(curve=top_chord_line, param=code_block_4)
vertical_line = Line.ByStartPointEndPoint(startPoint=pointAtParameter, endPoint=pointAtParameter_2)
vertical_analyticalbar_byline = DynamoSimulation.RSA.AnalyticalModel.AnalyticalBar.ByLine(line=vertical_line)
sections_3 = SectionBar("PIP 42.7x2.3")
setSectionByName_3 = DynamoSimulation.RSA.AnalyticalModel.AnalyticalBar.SetSectionByName(analyticalBars=vertical_analyticalbar_byline, name=sections_3)
list_create = List.Create(item0=pointAtParameter)
watch = Watch(list_create)
flatten = List.Flatten(list=watch)
code_block_5 = CodeBlock(n=จำนวนช_อง) { 1; n/2; }
slice = List.Slice(list=flatten, start=code_block_5.out0, end=code_block_5.out1)
incline1_line = Line.ByStartPointEndPoint(startPoint=slice, endPoint=pointAtParameter_2)
inc1_analyticalbar_byline = DynamoSimulation.RSA.AnalyticalModel.AnalyticalBar.ByLine(line=incline1_line)
sections_4 = SectionBar("PIP 101.6x4")
setSectionByName_4 = DynamoSimulation.RSA.AnalyticalModel.AnalyticalBar.SetSectionByName(analyticalBars=inc1_analyticalbar_byline, name=sections_4)
code_block_6 = CodeBlock(n=จำนวนช_อง) { 0..1..#n; }
pointAtParameter_3 = Curve.PointAtParameter(curve=top_chord_line, param=[code_block_6, code_block_6])
list_create_2 = List.Create(item0=pointAtParameter_3)
watch_2 = Watch(list_create_2)
flatten_2 = List.Flatten(list=watch_2)
code_block_7 = CodeBlock(n=จำนวนช_อง) { n/2; n; }
slice_2 = List.Slice(list=flatten_2, start=code_block_7.out0, end=code_block_7.n)
pointAtParameter_4 = Curve.PointAtParameter(curve=botton_chord_line, param=[code_block_6, code_block_6])
code_block_8 = CodeBlock(n=จำนวนช_อง) { n/2-1; n-1; }
slice_3 = List.Slice(list=pointAtParameter_4, start=code_block_8.out0, end=code_block_8.out1)
incline2_line = Line.ByStartPointEndPoint(startPoint=slice_2, endPoint=slice_3)
inc2_analyticalbar_byline = DynamoSimulation.RSA.AnalyticalModel.AnalyticalBar.ByLine(line=incline2_line)
sections_5 = SectionBar("PIP 101.6x4")
setSectionByName_5 = DynamoSimulation.RSA.AnalyticalModel.AnalyticalBar.SetSectionByName(analyticalBars=inc2_analyticalbar_byline, name=sections_5)
list_create_3 = List.Create(item0=byBars, item1=setSectionByName_2, item2=setSupportByName, item3=setSupportByName_2, item4=byPoint, item5=byPoint_2, item6=setSectionByName_3, item7=setSectionByName_4, item8=setSectionByName_5, item9=setSectionByName, item10=byNature)
flatten_3 = List.Flatten(list=list_create_3)
calculate = DynamoSimulation.RSA.Analysis.Calculate(elements=flatten_3)

# group: LENGTH OF MEMBERS
startNode = DynamoSimulation.RSA.AnalyticalModel.AnalyticalBar.StartNode(analyticalBar=calculate.analyticalBars)
X = DynamoSimulation.RSA.AnalyticalModel.AnalyticalNode.X(analyticalNode=startNode)
Y = DynamoSimulation.RSA.AnalyticalModel.AnalyticalNode.Y(analyticalNode=startNode)
Z = DynamoSimulation.RSA.AnalyticalModel.AnalyticalNode.Z(analyticalNode=startNode)
byCoordinates_5 = Point.ByCoordinates(x=X, y=Y, z=Z)
endNode = DynamoSimulation.RSA.AnalyticalModel.AnalyticalBar.EndNode(analyticalBar=calculate.analyticalBars)
X_2 = DynamoSimulation.RSA.AnalyticalModel.AnalyticalNode.X(analyticalNode=endNode)
Y_2 = DynamoSimulation.RSA.AnalyticalModel.AnalyticalNode.Y(analyticalNode=endNode)
Z_2 = DynamoSimulation.RSA.AnalyticalModel.AnalyticalNode.Z(analyticalNode=endNode)
byCoordinates_6 = Point.ByCoordinates(x=X_2, y=Y_2, z=Z_2)
distanceTo = Geometry.DistanceTo(geometry=byCoordinates_5, other=byCoordinates_6)

setUnion = List.SetUnion(list1=byCoordinates_5, list2=byCoordinates_6)
code_block_9 = CodeBlock { "FXSX"; }
flatten_4 = List.Flatten(list=calculate.analyticalBars)
code_block_10 = CodeBlock { 1; }
getMaxValuesList = DynamoSimulation.RSA.RSAResults.Bar.BarStresses.GetMaxValuesList(name=code_block_9, analyticalBars=flatten_4, loadCasesIds=code_block_10)
flatten_5 = List.Flatten(list=getMaxValuesList)

# group: STEEL TRUSS
abs = Math.Abs(number=flatten_5)
code_block_11 = CodeBlock { 1440; }
code_block_12 = CodeBlock(F=abs, Fa=code_block_11) { F/Fa; }
python_script = Python(IN[0]=code_block_12)  # CPython3
# ---------- python_script.python (64 lines) ----------
import sys
import clr
clr.AddReference('ProtoGeometry')
from Autodesk.DesignScript.Geometry import *

# The inputs to this node will be stored as a list in the IN variables.
A = IN[0]  # Assuming A is a list
# Place your code below this line

# Initialize empty lists for w and Section
w_list = []
Section_list = []

# Iterate through each element in the list A
for a in A:
    if a <= 1.779 :
        w = 1.41
        Section = 'o-27.2x2.3'
    elif a <= 2.291 :
        w = 1.80
        Section = 'o-34.0x2.3'    
    elif a <= 2.919 :
        w = 2.29
        Section = 'o-42.7x2.3' 
    elif a <= 4.564 :
        w = 3.58
        Section = 'o-48.6x3.2' 
    elif a <= 5.76 :
        w = 4.52
        Section = 'o-60.5x3.2' 
    elif a <= 7.349 :
        w = 5.77
        Section = 'o-76.3x3.2'         
    elif a <= 8.636 :
        w = 6.78
        Section = 'o-89.1x3.2'     
    elif a <= 12.26 :
        w = 9.63
        Section = 'o-101.6x4.0'     
    elif a <= 15.52 :
        w = 12.2
        Section = 'o-114.3x4.5'      
    elif a <= 19.13 :
        w = 15
        Section = 'o-139.8x4.5'      
    elif a <= 22.72 :
        w = 17.8
        Section = 'o-165.2x4.5'      
    elif a <= 30.01 :
        w = 23.6
        Section = 'o-165.2x6.0'     
    elif a <= 39.61 :
        w = 31.1
        Section = 'o-216.3x6.0'  
    else :
        w = 0
        Section = 'No Section to Selected'        
    
    # Append w and Section to their respective lists
    w_list.append(w)
    Section_list.append(Section)

# Assign your output to the OUT variable.
OUT = [Section_list]
# ----------------------------------------
watch_3 = Watch(python_script)
python_script_2 = Python(IN[0]=code_block_12)  # CPython3
# ---------- python_script_2.python (79 lines) ----------
import sys
import clr
clr.AddReference('ProtoGeometry')
from Autodesk.DesignScript.Geometry import *

# The inputs to this node will be stored as a list in the IN variables.
A = IN[0]  # Assuming A is a list
# Place your code below this line

# Initialize empty lists for w, Section, and D
w_list = []
Section_list = []
D_list = []

# Iterate through each element in the list A
for a in A:
    if a <= 1.779 :
        w = 1.41
        D = 27.2
        Section = 'o-27.2x2.3'
    elif a <= 2.291 :
        w = 1.80
        D = 34.0
        Section = 'o-34.0x2.3'    
    elif a <= 2.919 :
        w = 2.29
        D = 42.7
        Section = 'o-42.7x2.3' 
    elif a <= 4.564 :
        w = 3.58
        D = 48.6
        Section = 'o-48.6x3.2' 
    elif a <= 5.76 :
        w = 4.52
        D = 60.5
        Section = 'o-60.5x3.2' 
    elif a <= 7.349 :
        w = 5.77
        D = 76.3
        Section = 'o-76.3x3.2'         
    elif a <= 8.636 :
        w = 6.78
        D = 89.1
        Section = 'o-89.1x3.2'     
    elif a <= 12.26 :
        w = 9.63
        D = 101.6
        Section = 'o-101.6x4.0'     
    elif a <= 15.52 :
        w = 12.2
        D = 114.3
        Section = 'o-114.3x4.5'      
    elif a <= 19.13 :
        w = 15
        D = 139.8
        Section = 'o-139.8x4.5'      
    elif a <= 22.72 :
        w = 17.8
        D = 165.2
        Section = 'o-165.2x4.5'      
    elif a <= 30.01 :
        w = 23.6
        D = 165.2
        Section = 'o-165.2x6.0'     
    elif a <= 39.61 :
        w = 31.1
        D = 216.3
        Section = 'o-216.3x6.0'  
    else :
        w = 0
        Section = 'No Section to Selected'        
    
    # Append w, D, and Section to their respective lists
    w_list.append(w)
    D_list.append(D)
    Section_list.append(Section)

# Assign your output to the OUT variable.
OUT = [D_list]
# ----------------------------------------
watch_4 = Watch(python_script_2)
code_block_13 = CodeBlock(D=watch_4) { 3.14*D/10; }
code_block_14 = CodeBlock(Circumference=code_block_13) { 2*Circumference; }
sum = Math.Sum(values=code_block_14)
code_block_15 = CodeBlock { 30; }
จำนวนช_วโมงในการเช_อม = CodeBlock(L=sum, a=code_block_15) { L/a; }
code_block_16 = CodeBlock(hr=จำนวนช_วโมงในการเช_อม) { 1.07*hr; }
embodie_energy_from_joints = Watch(code_block_16)
python_script_3 = Python(IN[0]=code_block_12)  # CPython3
# ---------- python_script_3.python (64 lines) ----------
import sys
import clr
clr.AddReference('ProtoGeometry')
from Autodesk.DesignScript.Geometry import *

# The inputs to this node will be stored as a list in the IN variables.
A = IN[0]  # Assuming A is a list
# Place your code below this line

# Initialize empty lists for w and Section
w_list = []
Section_list = []

# Iterate through each element in the list A
for a in A:
    if a <= 1.779 :
        w = 1.41
        Section = 'o-27.2x2.3'
    elif a <= 2.291 :
        w = 1.80
        Section = 'o-34.0x2.3'    
    elif a <= 2.919 :
        w = 2.29
        Section = 'o-42.7x2.3' 
    elif a <= 4.564 :
        w = 3.58
        Section = 'o-48.6x3.2' 
    elif a <= 5.76 :
        w = 4.52
        Section = 'o-60.5x3.2' 
    elif a <= 7.349 :
        w = 5.77
        Section = 'o-76.3x3.2'         
    elif a <= 8.636 :
        w = 6.78
        Section = 'o-89.1x3.2'     
    elif a <= 12.26 :
        w = 9.63
        Section = 'o-101.6x4.0'     
    elif a <= 15.52 :
        w = 12.2
        Section = 'o-114.3x4.5'      
    elif a <= 19.13 :
        w = 15
        Section = 'o-139.8x4.5'      
    elif a <= 22.72 :
        w = 17.8
        Section = 'o-165.2x4.5'      
    elif a <= 30.01 :
        w = 23.6
        Section = 'o-165.2x6.0'     
    elif a <= 39.61 :
        w = 31.1
        Section = 'o-216.3x6.0'  
    else :
        w = 0
        Section = 'No Section to Selected'        
    
    # Append w and Section to their respective lists
    w_list.append(w)
    Section_list.append(Section)

# Assign your output to the OUT variable.
OUT = [w_list]
# ----------------------------------------
watch_5 = Watch(python_script_3)
code_block_17 = CodeBlock(w=watch_5, L=distanceTo) { w*L/1000; }
watch_6 = Watch(code_block_17)
flatten_6 = List.Flatten(list=watch_6)
sum_2 = Math.Sum(values=flatten_6)
total_steel_weight_tons = Watch(sum_2)
code_block_18 = CodeBlock(weight=total_steel_weight_tons) { 4.851*1000*weight; }
embodied_from_steel = Watch(code_block_18)
add = embodie_energy_from_joints + embodied_from_steel
total_embodied_carbon_kgco2 = Watch(add)

# group: STEEL-GLUBAM TRUSS
code_block_19 = CodeBlock { 0; }
gt = flatten_5 > code_block_19
code_block_20 = CodeBlock { true; false; }
if_ = RefactoredIf(test=gt, true=code_block_20.out0, false=code_block_20.out1)
filterByBoolMask = List.FilterByBoolMask(list=flatten_5, mask=if_)
code_block_21 = CodeBlock { 30; }

# group: STEEL-GLUBAM TRUSS > FIND TOTAL WEIGHT OF GLUBAM
code_block_22 = CodeBlock(F=filterByBoolMask.out) { F/520; }

# group (continued): STEEL-GLUBAM TRUSS
abs_2 = Math.Abs(number=code_block_22)

# group (continued): STEEL-GLUBAM TRUSS > FIND TOTAL WEIGHT OF GLUBAM
python_script_4 = Python(IN[0]=abs_2)  # CPython3
# ---------- python_script_4.python (53 lines) ----------
import sys
import clr
clr.AddReference('ProtoGeometry')
from Autodesk.DesignScript.Geometry import *

# The inputs to this node will be stored as a list in the IN variables.
A = IN[0]  # Assuming A is a list
# Place your code below this line

# Initialize empty lists for w and Section
w_list = []
Section_list = []

# Iterate through each element in the list A
for a in A:
    if a <= 9 :
        w = 0.72
        Section = '30x30'
    elif a <= 12.25 :
        w = 0.98
        Section = '35x35'    
    elif a <= 16 :
        w = 1.28
        Section = '40x40' 
    elif a <= 20.25 :
        w = 1.62
        Section = '45x45' 
    elif a <= 25 :
        w = 2
        Section = '50x50' 
    elif a <= 30.25 :
        w = 2.42
        Section = '55x55'         
    elif a <= 36 :
        w = 2.88
        Section = '60x60'     
    elif a <= 42.25 :
        w = 3.38
        Section = '65x65'     
    elif a <= 49 :
        w = 3.92
        Section = '70x70'      
  
    else :
        w = 0
        Section = 'No Section to Selected'        
    
    # Append w and Section to their respective lists
    w_list.append(w)
    Section_list.append(Section)

# Assign your output to the OUT variable.
OUT = [Section_list]
# ----------------------------------------
watch_7 = Watch(python_script_4)
python_script_5 = Python(IN[0]=abs_2)  # CPython3
# ---------- python_script_5.python (53 lines) ----------
import sys
import clr
clr.AddReference('ProtoGeometry')
from Autodesk.DesignScript.Geometry import *

# The inputs to this node will be stored as a list in the IN variables.
A = IN[0]  # Assuming A is a list
# Place your code below this line

# Initialize empty lists for w and Section
w_list = []
Section_list = []

# Iterate through each element in the list A
for a in A:
    if a <= 9 :
        w = 0.72
        Section = '30x30'
    elif a <= 12.25 :
        w = 0.98
        Section = '35x35'    
    elif a <= 16 :
        w = 1.28
        Section = '40x40' 
    elif a <= 20.25 :
        w = 1.62
        Section = '45x45' 
    elif a <= 25 :
        w = 2
        Section = '50x50' 
    elif a <= 30.25 :
        w = 2.42
        Section = '55x55'         
    elif a <= 36 :
        w = 2.88
        Section = '60x60'     
    elif a <= 42.25 :
        w = 3.38
        Section = '65x65'     
    elif a <= 49 :
        w = 3.92
        Section = '70x70'      
  
    else :
        w = 0
        Section = 'No Section to Selected'        
    
    # Append w and Section to their respective lists
    w_list.append(w)
    Section_list.append(Section)

# Assign your output to the OUT variable.
OUT = [w_list]
# ----------------------------------------
watch_8 = Watch(python_script_5)
code_block_23 = CodeBlock(w=watch_8, L=distanceTo) { w*L/1000; }
watch_9 = Watch(code_block_23)
flatten_7 = List.Flatten(list=watch_9)
sum_3 = Math.Sum(values=flatten_7)
total_glubam_weight_tons = Watch(sum_3)

# group: STEEL-GLUBAM TRUSS > FIND TOTAL WEIGHT OF STEEL
code_block_24 = CodeBlock(F=filterByBoolMask.in) { F/1440; }
python_script_6 = Python(IN[0]=code_block_24)  # CPython3; same code as python_script
watch_10 = Watch(python_script_6)
python_script_7 = Python(IN[0]=code_block_24)  # CPython3; same code as python_script_3
watch_11 = Watch(python_script_7)
code_block_25 = CodeBlock(w=watch_11, L=distanceTo) { w*L/1000; }
watch_12 = Watch(code_block_25)
flatten_8 = List.Flatten(list=watch_12)
sum_4 = Math.Sum(values=flatten_8)
total_steel_weight_tons_2 = Watch(sum_4)

# group: STEEL
total_embodied_carbon_kgco2_2 = Watch(total_embodied_carbon_kgco2)
total_steel_weight_tons_3 = Watch(total_steel_weight_tons)

total_steel_weight_tons_4 = Watch(total_steel_weight_tons_2)

# group (continued): STEEL-GLUBAM TRUSS
code_block_26 = CodeBlock(weight=total_steel_weight_tons_2) { 4.851*1000*weight; }
embodied_from_steel_2 = Watch(code_block_26)
code_block_27 = CodeBlock(weight=total_glubam_weight_tons) { (-0.401)*1000*weight; }
embodied_from_glubam = Watch(code_block_27)
add_2 = embodied_from_steel_2 + embodied_from_glubam
total_embodied_carbon_from = Watch(add_2)  # "TOTAL EMBODIED CARBON FROM MEMBER"
python_script_8 = Python(IN[0]=code_block_24)  # CPython3; same code as python_script_2
watch_13 = Watch(python_script_8)
code_block_28 = CodeBlock(D=watch_13) { 3.14*D/10; }
code_block_29 = CodeBlock(Circumference=code_block_28) { 2*Circumference; }
sum_5 = Math.Sum(values=code_block_29)
จำนวนช_วโมงในการเช_อม_2 = CodeBlock(L=sum_5, a=code_block_21) { L/a; }
code_block_30 = CodeBlock(hr=จำนวนช_วโมงในการเช_อม_2) { 1.07*hr; }
embodie_energy_from_joints_2 = Watch(code_block_30)
flatten_9 = List.Flatten(list=watch_8)
count = List.Count(list=flatten_9)
code_block_31 = CodeBlock(n=count) { 2*4.949*n; }
embodie_energy_from_joints_3 = Watch(code_block_31)
add_3 = embodie_energy_from_joints_2 + embodie_energy_from_joints_3
total_embodied_carbon_from_joint = Watch(add_3)
add_4 = total_embodied_carbon_from + total_embodied_carbon_from_joint
total_embodied_carbon_of_steel = Watch(add_4)  # "TOTAL EMBODIED CARBON OF STEEL-GLUBAM TRUSS (KGCO2)"

total_embodied_carbon_of_steel_2 = Watch(total_embodied_carbon_of_steel)  # "TOTAL EMBODIED CARBON OF STEEL-GLUBAM TRUSS (KGCO2)"
total_glubam_weight_tons_2 = Watch(total_glubam_weight_tons)
